# Grasshopper definition MeshVisualization_RH7.gh (Grasshopper 1.0.7)
# plug-ins: SD_Evaluation

# ---- group: Pedestrian Domain Creation
layergeo = LayerGeometry(ReferenceToggle=True, LayerName="Building Footprints")
# The buildings should completely lie within the sidewalk or the domain can be larger than origianl!!!
crv = Curve(<curve referenced from the Rhino model>)
peddomain = PedestrianDomain(Sidewalk=crv, Buildings=layergeo)  # -> PedDomain, DomainSurface

# ---- group: Circle Packing Simulation
init = InitializeSeeds(PedDomain=peddomain.PedDomain, Number=Slider(1800, range=0..10000))
# Iteration number not set more than 20
setting = CirclePackingSettings(PedDomain=peddomain.PedDomain, Radii=4.6, Seeds=init, PackingForce=Slider(1.2, range=0..10), ConstrainingForce=1)  # -> SimulationSetting, GoalObjects
simucp = SimulateCirclePacking(SimulationSettings=setting.SimulationSetting, Iterations=Slider(10, range=0..10))  # -> OutPoints, OutCircles, MaxCapacity

# ----
number_slider = Slider(3.9, range=0..10)

# ---- group: Medial Axis Creation
# The MAS Smoothing component have a high chance of not working because of the quality of the original MAS lines. Use the original lines as Segs if that happens!!!
mal = MedialAxisLines(PedDomain=peddomain.PedDomain, RebuildResolution=number_slider)  # -> MedialAxisSkeletons, AdaptedResolution
ma = MedialAxisSmooth(MedialAxisSkeletons=mal.MedialAxisSkeletons, RebuildResolution=number_slider)  # -> BranchingPoints, NakedPoints, SkeletonCurves, NakedCurves, SegmentedSampleCurves, AllSegments

# ----
crv_2 = Curve(mal.MedialAxisSkeletons)
crv_3 = Curve(ma.SegmentedSampleCurves)
crv_4 = Curve(ma.SegmentedSampleCurves)
dmesh = DomainQuadRemesh(PedDomain=peddomain.PedDomain)

# ---- group: Score evaluation based on SD threshold
evalcp = EvaluateByCirclePacking(
    PedestrianDomain=peddomain.PedDomain,
    Segments=ma.SegmentedSampleCurves,
    Thredhold=9.2,
    CirclePackingGrid=simucp.OutPoints)
eval = Evaluate(PD=peddomain.PedDomain, Seg=crv_4, Thr=9.2)  # -> Pass, Dist, Score

# ----
# the result from ray intersection are always 1 more score than the result from circle packing, that is because the packing system makes all circle inside the boundary, but actually we can have half of our safe distance outside of the region...
mesh = Mesh(dmesh)
bnd = Bounds(Numbers=eval.Dist)
number_slider_2 = Slider(20, range=0..100)
number_slider_3 = Slider(5, range=3..10)
remap = RemapNumbers(Value=eval.Dist, Source=bnd, Target=Domain(0, 5))  # -> Mapped, Clipped

# ---- group: Path score visualization
path = PathScoreVisualization(SegmentPaths=crv_4, ThredholdScores=evalcp, Multiplier=number_slider_2)
path_2 = PathScoreVisualization(SegmentPaths=crv_4, ThredholdScores=remap.Mapped, Multiplier=number_slider_2)
path_3 = PathScoreVisualization(SegmentPaths=crv_4, ThredholdScores=eval.Score, Multiplier=number_slider_2)

# ---- group: mesh visualization
safety = SafetyVisualization(
    SegmentPaths=ma.SegmentedSampleCurves,
    ThredholdScores=expr("x-1", eval.Score),
    Mesh=mesh,
    KNeighbours=number_slider_3,
    Standard=2)  # -> MeshSafety, VertexSafetyValue
safety_2 = SafetyVisualization(SegmentPaths=ma.SegmentedSampleCurves, ThredholdScores=evalcp, Mesh=mesh, KNeighbours=number_slider_3, Standard=2)  # -> MeshSafety, VertexSafetyValue
comfort = ComfortVisualization(
    SegmentPaths=ma.SegmentedSampleCurves,
    Distances=eval.Dist,
    Mesh=mesh,
    KNeighbours=number_slider_3,
    Thredhold=9.2,
    ClampDown=1.1,
    ClampUp=Slider(0.89, range=0.11..0.99))  # -> MeshComfort, VertexSafetyValue
