# Grasshopper definition VolumeAndSkeletonCreation.gh (Grasshopper 1.0.7)
# plug-ins: SD_Evaluation

layergeo = LayerGeometry(ReferenceToggle=True, LayerName="Building Footprints")
crv = Curve(<curve referenced from the Rhino model>)
peddomain = PedestrianDomain(Sidewalk=crv, Buildings=layergeo)  # -> PedDomain, DomainSurface
mal = MedialAxisLines(PedDomain=peddomain.PedDomain, RebuildResolution=Slider(4, range=0..10))  # -> MedialAxisSkeletons, AdaptedResolution
ma = MedialAxisSmooth(MedialAxisSkeletons=mal.MedialAxisSkeletons, RebuildResolution=Slider(5, range=0..10))  # -> BranchingPoints, NakedPoints, SkeletonCurves, NakedCurves, SkeletonSegments, AllSegments
